# Requirement set Aurora_Requirements (R2024b)

Attributes:
- Additional Notes: Imported from Excel:Additional Notes
- Applicability: Imported from Excel:Applicability
- Notes: Imported from Excel:Notes
- Verification Method: Imported from Excel:Verification Method

## 1 [Aurora Requirements!EUROC REQ] References to Aurora Requirements.xlsx (EUROC REQ) (Container)
Imported from Microsoft Excel

### 1.1 [RQT-0010] Non-toxic propellants
Launch vehicles entering EuRoC shall use non-toxic propellants
Applicability: Propulsion System
Notes: Ammonium perchlorate composite propellant (APCP), potassium nitrate and sugar (also known as "rocket candy"), nitrous oxide, liquid oxygen (LOX), hydrogen peroxide, kerosene, propane, alcohol, and similar substances, are all considered non-toxic. Toxic propellants are defined as those requiring breathing apparatus, unique storage and transport infrastructure, extensive personal protective equipment (PPE), etc. Home-made propellant mixtures containing any fraction of toxic propellants are also prohibited.
Verification Method: S

### 1.2 [RQT-0020] Air-start ignition circuit electronics
All upper stage and secondary ignition systems shall comply with the recovery systems redundant electronics and safety critical wiring requirements specified in Sections 5.1 (EuRoC-LV-RQT-0240 to EuRoC-LV-RQT-0280) and 5.4 respectively.
Applicability: Upper stage and secondary propulsion systems
Notes: In this case “initiation” refers to upper stage ignition rather than a recovery event
Verification Method: S , I

### 1.3 [RQT-0030] Ground-start ignition circuit arming distance
All ground-started propulsion system ignition circuits/sequences shall be capable of being armed and disarmed with no personnel within 15 m of the launch vehicle.
Applicability: Ground-started ignition circuits
Verification Method: SC

### 1.4 [RQT-0040] Clustered vehicle release system
All clustered vehicles shall have a launch release system ensuring lift-off only occurs if a minimum threshold force is met.
Rationale: Partial ignition may occur in clustered propulsion systems, leading to an increased probability of incident occurrence.
Applicability: Clustered vehicles
Notes: The release system can be implemented for example by a breakaway coupling, a structural fuse, a rope with defined breaking force, slightly tilting the motors outward or air starting. Other alternative examples can be found in Appendix A.
Verification Method: I, IDT

### 1.5 [RQT-0050] Clustered vehicle stability proof
All clustered vehicles shall be capable of performing a stable flight for any lift-off force above the minimum threshold value.
Applicability: Clustered vehicles
Notes: This requirement is applicable in any situation in which the threshold force is met, even if the propulsion system fires asymmetrically.
Verification Method: C

### 1.6 [RQT-0060] Clustered vehicle arming
For vehicles with a “main” and several “secondary” propulsion systems, the arming function of the secondary propulsion systems shall only be armed by launch detection (i.e., air-start).
Rationale: Prevention of ground arming of the clustered propulsion in the event of misfire.
Applicability: Clustered vehicles
Notes: More information on the air-start circuit arming requirement in EuRoC-LV-RQT0070
Verification Method: I, A

### 1.7 [RQT-0070] Air-start ignition circuit arming
All upper stage and “secondary” (i.e., air-start) propulsion systems shall only be armed by launch detection
Rationale: This arming function will prevent the upper stage from arming in the event of a misfire.
Applicability: Upper stage and secondary propulsion systems
Notes: Possible implementations include accelerometers, zero separation force (ZSF) electrical shunt connections, break-wires, or other similar methods.
Verification Method: I, A

### 1.8 [RQT-0080] COTS solid motors
All COTS solid motors shall be selected from the official EuRoC Motors List [RD02].
Applicability: COTS Solid Motors
Notes: More information on the motor acquisition process can be found in the EuRoC COTS Motors Acquisition [RD03], which will be made available before the event, in due time.
Verification Method: S

### 1.9 [RQT-0090] Ignition systems for solid motors
All solid motors shall use the electronic ignition system provided by EuRoC.
Applicability: COTS and SRAD Solid Motors
Verification Method: S

### 1.10 [RQT-0100] Active pressurization
All gaseous and liquid propellant system shall be able to be externally pressurized with inert gas.
Rationale: The use of “passive” or “self-pressurization” of propellants have high safety risks and operational issues associated.
Applicability: Hybrid and liquid propulsion systems
Notes: This requirement removes the significant propellant density uncertainties of twophase flows (a volatile and somewhat arbitrary mixture of gas bubbles and liquid) in injectors, reduces the need for thermal conditioning of propellants prior to loading, and creates conditions for the flight vehicle to be able to be pressurized in typically less than 15 seconds, at any point in time after having been loaded on the launch rail. Additionally, and specifically for nitrous oxide, the pressurization by inert gas dilutes the gaseous nitrous oxide in the ullage of the tank, raising its activation energy and lowering the probability of runaway decomposition.
Verification Method: S, I

### 1.11 [RQT-0110] Loading lines disconnection
Systems employing any gaseous or liquid propellants shall perform propellant tank pressurization after all propellant and pressurant loading lines are disconnected.
Rationale: If a remote-controlled loading line disconnection fails, and a hands-on manual disconnection is required, propellant tank pressures will still be at the low levels fit for ground operations near the launch vehicle.
Applicability: Hybrid and liquid propulsion systems
Verification Method: S, I

### 1.12 [RQT-0120] Dissimilar connections
All loading lines, used for pressurization gases or propellants, shall feature dissimilar connectors.
Rationale: The safety hazards of such propellant and/or pressurant mix-ups are extreme and must be prevented at any level of design, manufacturing, integration, and test
Applicability: Hybrid and liquid propulsion systems
Notes: The dissimilar connections shall be made in such a way that it is impossible to form a leak-tight connection with the wrong connector.
Verification Method: S, I

### 1.13 [RQT-0130] Remote-controlled loading mechanism and respective emergency release mechanism
Any remote-controlled loading mechanism for gases or liquid propellants shall feature a clearly marked and labelled, single action, hand actuated, “Emergency Release Mechanism”.
Rationale: In case a remote-controlled release mechanism jams and requires manual Launch Control Officer’s assistance.
Applicability: Remote-controlled loading mechanisms
Verification Method: SC

### 1.14 [RQT-0140] Filling/loading/unloading connections
Any filling/loading/unloading connections for fluid propellants shall be readily accessible from the ground, when the rocket is in vertical launch position.
Applicability: Hybrid and liquid propulsion systems
Notes: All fluid connections shall be accessible without the need for stools, ladders, or other climbing devices.
Verification Method: SC

### 1.15 [RQT-0150] Filling/loading/unloading timing
Teams shall demonstrate that the filling/loading/unloading of the liquid fuels can be done to be ready for the launch window (maximum 90 minutes for liquid propellant loading, including pressurization).
Applicability: Hybrid and liquid propulsion systems
Notes: Teams should account for a “failed” launch and subsequent unloading in launch preparation, thus teams should ensure the availability of additional propellants, igniters, and any other parts that might need replacement or adjustment in case a second launch attempt would be possible.
Verification Method: A, T

### 1.16 [RQT-0160] Venting
For hybrid and liquid motors, teams shall facilitate oxidizer tank venting to prevent over-pressure situations.
Rationale: Teams will only be able to launch in specific time slots, so pressure relief measures shall be implemented to account for rockets potentially sitting a long time in waiting on the launch rail.
Applicability: Hybrid and liquid propulsion systems
Verification Method: S, I

### 1.17 [RQT-0170] Passive PRD in isolated sections of pressurized lines
All isolated sections of pressurized lines (including pressure vessels) shall incorporate a passive pressure relief device (PRD) with an opening set point below the maximum tested pressure of that line section.
Rationale: At no time must oxidizer tanks become safety liabilities.
Applicability: Hybrid and liquid propulsion systems
Verification Method: I, C

### 1.18 [RQT-0180] PRD discharge coefficient
All pressure relief devices shall have a discharge coefficient equal to or higher than any other fluid interface on the respective pressurized section in which they are installed.
Rationale: At no time must oxidizer tanks become safety liabilities.
Applicability: Hybrid and liquid propulsion systems
Verification Method: A, C

### 1.19 [RQT-0190] Propellant offloading after launch abort
Hybrid and liquid propulsion systems shall implement a means for remotely controlled venting or offloading of all liquid and gaseous propellants in the event of a launch abort.
Applicability: Hybrid and liquid propulsion systems
Verification Method: A

### 1.20 [RQT-0200] Combustion chamber pressure test
SRAD and modified COTS propulsion system combustion chambers shall be designed and tested according to the SRAD pressure vessel requirements defined in Sections 0 and 6.3, respectively.
Applicability: SRAD and modified COTS combustion chambers
Notes: Combustion chambers are exempted from the requirement for a relief device
Verification Method: T

### 1.21 [RQT-0210] Combustion chamber leak proof
Combustion chambers shall be designed allowing to be closed off in a leak-tight manner for testing at any section between the throat and the exit section of the nozzle.
Applicability: SRAD and modified COTS combustion chambers
Verification Method: A, T

### 1.22 [RQT-0220] Hybrid and liquid tanking test
SRAD and modified COTS propulsion systems using liquid propellant(s) shall successfully (without significant anomalies) have completed a propellant loading and offloading test in "launch-configuration", prior to the competition.
Rationale: Loading and unloading of liquid propellants must be a well-drilled, safe and efficient operation during the competition launch operations.
Applicability: Hybrid and liquid propulsion systems
Notes: The test may be conducted using either actual propellant(s) or suitable proxy fluids, with the test results to be considered a mandatory deliverable and an annex to the Technical Report, in the form of a loading and offloading checklist, complete with dates, signatures (at least three) and a statement of a successful test. Failure to deliver this annex will automatically result in a “denied” flight status. It is highly recommended to perform this test multiple times as part of the “all-up static engine test” configuration (please refer to EuRoC-LV-RQT-0230).
Verification Method: T

### 1.23 [RQT-0230] Static hot-fire test
SRAD propulsion systems shall successfully (without significant anomalies) complete an instrumented (chamber pressure and/or thrust), full scale (including system working time) static hotfire test prior to EuRoC.
Rationale: “Test as you fly – Fly as you test”. This test-mentality significantly increases the chances of a lift-off and a nominal flight.
Applicability: SRAD propulsion systems (S/H/L)
Notes: The test shall, to the extent possible, be conducted as an “all-up static engine test”, which means that the complete flight vehicle, rigidly fastened to a suitable test stand in an upright position, should be tested for a full duration burn under the most realistic settings possible. Test results from horizontal tests, using flight components is less optimum, whereas test results from test benches (not using flight components) do not qualify. In the case of solid rocket motors, this test does not need to be performed with the same motor casing and/or nozzle components intended for use at EuRoC (i.e., teams must verify their casing design but are not forced to design reloadable/reusable motor cases). The test results and a statement of a successful test, complete with dates and signatures (at least three) are considered a mandatory deliverable and an annex to the Technical Report. Failure to deliver this annex will automatically result in a “denied” flight status.
Verification Method: T

### 1.24 [RQT-0240] Redundant recovery system electronics
Launch vehicles shall implement fully redundant recovery system electronics, including sensors/flight computers and "electric initiators", with a separate power supply (i.e., battery).
Rationale: Assure initiation by a backup system if the primary system fails.
Applicability: Recovery system
Notes: In this context, electric initiators are the devices energized by the sensor electronics, which then initiates some other mechanical or chemical energy release, to deploy its portion of the recovery system (i.e., electric matches, nichrome wire, flash bulbs, etc.)
Verification Method: S

### 1.25 [RQT-0250] Redundant COTS recovery electronics
At least one redundant recovery system electronics subsystem shall implement a COTS flight computer.
Applicability: Recovery system
Notes: Examples of COTS flight computers are: StratoLogger, G-Wiz, Raven, Parrot, Eggtimer, AIM, EasyMini, TeleMetrum, RRC3, CATS, etc. More information on the permitted systems and implementation of the redundant recovery electronics can be found in Error! Reference source not found..
Verification Method: S

### 1.26 [RQT-0260] Recovery electronics access panel
All electronics switches or connectors that need to be manually operated shall be accessible from outside the vehicle via either access panels or direct mounting on the outer skin
Rationale: Improve launch operations efficiency by a quick and easy access to the electronics while the vehicle is vertical on the launch rail.
Applicability: All electronics
Notes: Access panels shall be secured for flight.
Verification Method: SC

### 1.27 [RQT-0270] Recovery electronics location
All electronics switches or connectors that need to be manually operated shall be readily accessible from the ground, when the rocket is in vertical launch position.
Rationale: Improve launch operations efficiency by a quick and easy access to the electronics while the vehicle is vertical on the launch rail.
Applicability: All electronics
Notes: All electronics shall be accessible without the need for stools, ladders or other climbing devices.
Verification Method: SC

### 1.28 [RQT-0280] Recovery electronics access
All electronics switches or connectors that need to be manually operated shall be mounted on the vehicle side opposite to the launch rail.
Rationale: Improve launch operations efficiency by a quick and easy access to the electronics while the vehicle is vertical on the launch rail.
Applicability: Recovery system
Verification Method: SC

### 1.29 [RQT-0290] Recovery system energetic devices
All stored-energy devices (i.e., energetics) used in recovery systems shall comply with the energetic device requirements defined in Section 6.1 of this document.
Applicability: Recovery system energetic devices
Verification Method: S

### 1.30 [RQT-0300] Onboard power systems
All onboard systems shall be free of batteries with either lithium-polymer or lithium (nonrechargeable) chemistry
Rationale: LiPo cells have negligible mechanical resilience, low ignition temperature and an exothermic decomposition nature. Lithium chemistry (non-rechargeable) cells have high probability of metallic lithium, REACH concerns or toxicity/environmental impact.
Applicability: Onboard power systems
Notes: This requirement applies regardless of the battery encapsulation form factor and only applies to the onboard systems, off-board systems are exempt of such requirement. Teams can find the battery general prioritisation, and allowed characteristics, according to toxicity, flammability, environmental hazards, etc. in Appendix C.
Verification Method: S, I

### 1.31 [RQT-0310] Onboard power systems access
Onboard batteries shall be readily accessible from the ground, when the rocket is in vertical launch position.
Rationale: Improve launch operations efficiency by a quick and easy access to the onboard power systems while the vehicle is vertical on the launch rail.
Applicability: Onboard power systems
Notes: Teams can find implementation strategies and examples for improved onboard power systems design on Appendix C.
Verification Method: SC

### 1.32 [RQT-0320] Launch rail standby time
Onboard power systems shall have at least six hours of battery lifetime on the launch rail.
Applicability: Onboard power systems
Notes: Teams can find implementation strategies and examples for improved onboard power systems design on Appendix C.
Verification Method: S

### 1.33 [RQT-0330] Non-parachute/parafoil recovery systems
Teams exploring other recovery methods (i.e., non-parachute or parafoil based) shall mention it in the dedicated field of the Technical Questionnaire [RD04].
Applicability: Non-typical recovery methods
Notes: EuRoC organisation may make additional requests for information and draft unique requirements depending on the team's specific design implementation.
Verification Method: S, I, A, IDT

### 1.34 [RQT-0340] Dual deployment recovery
Each independently recovered launch vehicle body, anticipated to reach an apogee above 450 m above ground level (AGL), shall follow a dual deployment recovery operations concept.
Notes: A dual-deployment recovery operations concept features an initial deployment event (e.g., a drogue parachute deployment; reefed main parachute deployment or similar) and a main deployment event (e.g., a main parachute deployment; main parachute un-reefing or similar) Independently recovered bodies, whose apogee is not anticipated to exceed 450 m AGL, are exempt and may feature only a single/main deployment event.
Verification Method: A, C

### 1.35 [RQT-0350] Initial deployment event altitude
The initial deployment event shall occur at or near apogee.
Applicability: Any part, assembly or device, featuring an initial deployment event
Verification Method: A, C

### 1.36 [RQT-0360] Initial deployment event descent velocity
The initial deployment event shall result in a descent velocity between 23 and 46 m/s.
Rationale: Reduce the vehicle descent rate sufficiently to permit the main deployment event, yet not so much as to exacerbate wind drift.
Applicability: Any part, assembly or device, featuring an initial deployment event
Verification Method: A, C

### 1.37 [RQT-0370] Main deployment event altitude
The main deployment event shall occur at an altitude no higher than 450 m AGL.
Applicability: Any part, assembly or device, featuring a main deployment event
Verification Method: A, C

### 1.38 [RQT-0380] Main deployment event descent velocity
The main deployment event shall result in a descent velocity of less than 9 m/s.
Rationale: Reduce the vehicle's descent rate sufficiently to prevent excessive damage upon impact with ground.
Applicability: Any part, assembly or device, featuring a main deployment event
Verification Method: A, C

### 1.39 [RQT-0390] Ejection gas protection
The recovery system shall implement adequate protection (e.g., fire-resistant material, pistons, baffles etc.) to prevent hot ejection gases (if implemented) from causing burn damage to retaining chords, parachutes, and other vital components as the specific design demands.
Applicability: Recovery systems using hot ejection gases
Verification Method: S, I

### 1.40 [RQT-0400] Parachute swivel links
The recovery system rigging (e.g., parachute lines, risers, shock chords, etc.) shall implement swivel links at any connections including single-threaded anchors.
Rationale: Mitigate the risk of torque loads unthreading bolted connections during recovery as well as parachute lines twisting up.
Applicability: Recovery systems rigging
Notes: The use of swivel links is intended to relieve torsion in the rigging, which can unscrew eyebolts and similar components. Mechanical connections that use multiple threads in parallel and thus cannot be untwisted by line torsion are exempt from this requirement.
Verification Method: S, I

### 1.41 [RQT-0410] Dual deployment parachute coloration
Dual deployment parachutes shall be visually highly dissimilar from one another.
Rationale: This will enable ground-based observers to characterize deployment events more easily.
Applicability: Dual deployment parachutes
Notes: This is typically achieved by using parachutes whose primary colours contrast those of the other chute
Verification Method: S

### 1.42 [RQT-0420] Parachute coloration
Utilised parachutes shall use colours providing a clear contrast to a blue sky, a grey/white cloud cover and ground vegetation (i.e. avoiding certain shades of green and brown, as well as black).
Rationale: To ease the location of the vehicle during descent and recovery operations
Applicability: All parachutes
Notes: Colours such as orange and red are favourable
Verification Method: S

### 1.43 [RQT-0430] Mandatory system
Launch vehicle stages and deployable payloads shall feature a mandatory operational CATS Vega Flight Computer for official altitude logging and landing site tracking purposes.
Rationale: Provide the EuRoC team with the means to easily determine and record the apogee altitude in a fast, efficient, consistent and equally fair (hence identical) way for all teams. Provide the student/recovery teams an efficient means of quickly tracking down the location of all launch flight vehicles (and any other tracked payload/components), to quickly clear the launch range.
Applicability: Stages of launch vehicles and deployable payloads
Notes: Modifications/adaptations to the mandatory CATS system are not allowed. More information, guidelines and examples applicable to the CATS system can be found in Appendix D. Technical details on the CATS Vega Flight Computer along with recommendations can be found in the CATS User Manual, available on the EuRoC website. For more general information on the CATS systems refer to https://catsystems.io.
Verification Method: S

### 1.44 [RQT-0440] CATS transmitter call-sign
Teams shall assign to each transmitter a “call-sign” (referred to in the CATS User Manual as the tele_link_phrase telecommand) respecting a specific string format to be found in Appendix D.
Applicability: CATS systems
Notes: Teams shall assign to each transmitter a “call-sign” (referred to in the CATS User Manual as the tele_link_phrase telecommand) respecting a specific string format to be found in Appendix D.
Verification Method: S

### 1.45 [RQT-0450] CATS Vega firmware update
Teams will be required to fly a specific firmware version in each mandatory CATS flight computer, mandated by the EuRoC organization.
Applicability: CATS systems
Notes: The EuRoC firmware version requirement still applies to CATS flight computers, regardless of if flown as inert “cargo” (no interfaces to any part of the recovery system) or as the mandatory COTS flight computer. CATS flight computers not featuring the mandated EuRoC firmware version will be considered SRAD flight computers. Information on the CATS Vega firmware update procedure can be found in the CATS User Manual, available on the EuRoC website
Verification Method: S

### 1.46 [RQT-0460] CATS receiver
The CATS Ground Station shall be used for telemetry and tracking in conjunction with the mandatory system.
Applicability: CATS systems
Notes: Information on the CATS Ground Station can be found in the CATS User Manual, available on the EuRoC website.
Verification Method: S

### 1.47 [RQT-0470] CATS electronics
CATS devices shall comply with the electronics general electronics requirements EuRoC-LV-RQT0260, EuRoC-LV-RQT-0270 and EuRoC-LV-RQT-0280.
Rationale: Improve launch operations efficiency by a quick and easy access to the electronics while the vehicle is vertical on the launch rail.
Applicability: CATS systems
Verification Method: S

### 1.48 [RQT-0480] Cable management
All safety critical wiring shall implement a cable management solution (e.g., wire ties, wiring, harnesses, cable raceways).
Rationale: Prevent tangling and excessive free movement of significant wiring/cable lengths due to expected launch loads.
Applicability: Safety critical wiring
Notes: A slack is necessary at all connections/terminals to prevent unintentional de-mating due to expected launch loads transferred into wiring/cables at physical interfaces.
Verification Method: S, I

### 1.49 [RQT-0490] Secure connections
All safety critical wiring/cable connections shall be sufficiently secure as to prevent de-mating due to expected launch loads.
Applicability: Safety critical wiring
Notes: This will be evaluated by a "tug test", in which the connection is gently but firmly "tugged" by hand to verify it is unlikely to break free in flight.
Verification Method: I

### 1.50 [RQT-0500] Cryo-compatible wire insulation
In case of propellants with a boiling point of less than -50°C any wiring or harness passing within close proximity of a cryogenic device (e.g., valve, piping, etc.) or a cryogenic tank (e.g., a cable tunnel next to a LOX tank) shall utilize safety critical wiring with cryo-compatible insulation (i.e., Teflon, PTFEvariants, etc.).
Applicability: Safety critical wiring for cryogenic conditions
Verification Method: I

### 1.51 [RQT-0510] Electronics thermal testing
Teams shall thermally test the electronics to know the reliable operational temperature range, implement cooling or venting provisions and monitor at least one temperature sensor representative of the electronics temperature.
Rationale: Experience from prior EuRoC events reveal that electronics problems account for an estimated 70% of cases where teams experience unreliable electronics, loss of telemetry, loss of control or other anomalies, which often leads to scrubbed launches or even loss of the flight vehicle.
Applicability: Electronics
Notes: The test results and a statement of a successful test, complete with dates and signatures (at least three) are considered a mandatory deliverable and annex to the Technical Report. Failure to deliver this annex will automatically result in a “denied” flight status. Teams must take into account that the flight vehicle may stay on a launch rail for several hours exposed to direct sun and high temperatures, with closed electronics compartments. Black coloration results in maximum thermal absorption. Teams shall also treat the electronics and systems considering that the rocket can sit on the rail in case of heavy rainfall. Particularly, any equipment or electronics operating on 230 V main power needs to be protected from rain, due to the risk of short circuits and electric shock.
Verification Method: T

### 1.52 [RQT-0520] Recovery system ground test demonstration
All recovery system mechanisms shall be successfully (without significant anomalies) tested prior to EuRoC, either by flight testing, or through one or more ground tests of key subsystems.
Rationale: Correct, reliable and repeatable recovery system performance is absolute top priority from a safety point of view.
Applicability: Recovery systems
Notes: In the case of ground tests, sensor electronics shall be functionally included in the demonstration by simulating the environmental conditions under which the deployment function is triggered.

The test results and a statement of a successful test, complete with dates and signatures (at least three) are considered a mandatory deliverable and annex to the Technical Report. Failure to deliver this annex will automatically result in a “denied” flight status.

More information on optional and advisable tests are referred to in Appendix B3
Verification Method: T

### 1.53 [RQT-0530] Energetic device safing and arming
All energetics shall be “safed” until the rocket is in the launch position, at which point they may be "armed".
Applicability: All energetics other than propulsion related
Notes: While EuRoC-LV-RQT-0030 requires propulsion systems to be armed only after the launch rail area is evacuated to a specified distance, this requirement permits personnel to arm other stored-energy devices at the launch rail.
Verification Method: SC

### 1.54 [RQT-0540] Arming device access
All energetic device arming features shall comply with the requirements EuRoC-LV-RQT-0260, EuRoC-LV-RQT-0270 and EuRoC-LV-RQT-0280
Rationale: Improve launch operations efficiency by a quick and easy access to the electronics while the vehicle is vertical on the launch rail.
Applicability: All energetics
Verification Method: SC

### 1.55 [RQT-0550] Arming device location
All energetic device arming features shall be located on the airframe.
Rationale: Any inadvertent energy release by these devices will not impact personnel arming them.
Applicability: All energetics
Notes: For example, the arming key switch for an energetic device used to deploy a hatch panel shall not be located at the same airframe clocking position as the hatch panel deployed by that charge
Verification Method: S

### 1.56 [RQT-0560] Burst discs
Each SRAD pressure vessel and every propellant tank shall implement an over-pressure safety measure, in the form of a (replaceable) burst disc, with a diaphragm orifice diameter of no less than 6 millimetres. The burst (or rupture) disc solution can be either COTS or SRAD.
Applicability: SRAD and modified COTS pressure vessels and tanks
Notes: Given the scarcity of COTS burst disc options and the coarse and limited range of burst pressures available, SRAD burst discs are equally viable and reliable, provided that proper care is taken to design, manufacture, test, and document it. Teams can find in Appendix E2 practical examples of manufacturing, burst pressure tailoring and testing. Two noticeable exceptions for fitting of mandatory burst discs (and relief devices) are combustion chambers (of any type) and COTS composite overwrapped pressure vessels (COPV), with a nominal operating pressure of 300 bar/4500 psi or above. The burst pressures safety factor is a factor of 3 for such COPVs, resulting in burst pressures well outside the capabilities/range of the compressor systems and/or COTS gas supplier bottles.
Verification Method: A, I

### 1.57 [RQT-0570] Burst disc pressure
Burst discs (COTS or SRAD) shall be selected or calibrated to rupture at a pressure no higher than 1,25 times the nominal tank pressure.
Applicability: Burst discs
Notes: Teams are recommended to select (or calibrate) for a rupture pressure in the range of 1,15 to 1,20 of the nominal tank pressure. This leaves adequate margin up to the 1,50 times proof pressure (see requirement EuRoC-LV-RQT-0640 regarding proof pressure testing)
Verification Method: A, I, C

### 1.58 [RQT-0580] Burst disc marking
Burst disc orifices (the body which determines the rupture pressure) shall be clearly and permanently marked with the average rupture pressure determined by testing, along with a unique identifier, tracing each burst disc orifice to an associated test report.
Applicability: Burst discs
Notes: Punching, engraving, grinding, etching, etc. counts as permanent marking. Various permanent markers based on ink or paint do not. For COTS burst disks, an equivalent certificate shall be requested from the manufacturer. More information on the burst disc testing can be found in Appendix E2.
Verification Method: I

### 1.59 [RQT-0590] Burst discs material
All SRAD burst discs shall come from the same stock material sheet, both for flight, testing and rupture pressure characterization.
Rationale: Using the same sheet material everywhere eliminates risk incurred by accidentally mixing up burst discs of different material thickness
Applicability: SRAD burst discs
Notes: Teams are recommended to pick out a sheet of material sufficiently large to cover all burst disc needs.
Verification Method: S

### 1.60 [RQT-0600] Relief device
SRAD pressure vessels shall implement an additional relief device, set to open in the range of 1,10 to 1,20 times the nominal operating pressure.
Applicability: SRAD and modified COTS pressure vessels
Notes: For the applicable exception to this requirement please refer to the note on requirement EuRoC-LV-RQT-0200.
Verification Method: A, T

### 1.61 [RQT-0610] Designed burst pressure for metallic pressure vessels
SRAD and modified COTS pressure vessels constructed entirely from isotropic materials (e.g., metals) shall be designed to a burst pressure no less than 2 times the maximum expected operating pressure.
Applicability: Metallic SRAD and modified COTS pressure vessels
Notes: The maximum operating pressure is the maximum pressure expected during prelaunch, flight, and recovery operations.
Verification Method: A, IDT

### 1.62 [RQT-0620] Designed burst pressure for composite pressure vessels
All SRAD and modified COTS pressure vessels either constructed entirely from non-isotropic materials (e.g., fibre reinforced plastics (FRP), composites) or implementing composite overwrap of a metallic vessel (i.e., composite overwrapped pressure vessels (COPV)), shall be designed to a burst pressure no less than 3 times the maximum expected operating pressure.
Applicability: Composite SRAD and modified COTS pressure vessels
Notes: The maximum operating pressure is the maximum pressure expected during prelaunch, flight, and recovery operations.
Verification Method: A, IDT

### 1.63 [RQT-0630] Burst discs testing
Individual test reports are required for each SRAD burst disc orifice, tied to its unique identifier or serial number. Each burst disc orifice test report must contain a minimum of five consecutive rupture tests, preferably using a data logging system and a pressure transducer for optimum rupture pressure documentation. The burst disc sheet metal must also be specified in detail.
Applicability: Burst discs
Notes: The rupture pressure to be marked on the burst disc orifice is the average of five consecutive rupture tests. The test results and a statement of a successful test, complete with dates and signatures (at least three) are considered a mandatory deliverable and annex to the Technical Report. Failure to deliver this annex will automatically result in a “denied” flight status.
Verification Method: T

### 1.64 [RQT-0640] Proof pressure testing
SRAD and modified COTS pressure vessels shall be proof pressure tested successfully (without significant anomalies) to 1,5 times the maximum expected operating pressure for no less than twice the maximum expected system working time, using the intended flight article(s) (e.g., the pressure vessel(s) used in proof testing must be the same one(s) flown at EuRoC).
Rationale: Pressure testing is an important factor in instilling confidence in the structural strength and integrity of the flown pressure vessels. Since liquid propellant loading onto hybrid or bi-liquid propelled flight vehicles may, in the majority of cases, involve manual loading, there will be times where ground personnel will be in close proximity with pressurized systems. It is crucial that ground personnel safety is heightened by the use of proof pressure tested pressure vessels.
Applicability: SRAD and modified COTS pressure vessels
Notes: The maximum system working time is defined as the maximum uninterrupted time duration the vessel will remain pressurized during pre-launch, flight, and recovery operations (which for example could be hours for self-pressurized nitrous oxide propellant systems). The test results and a statement of a successful test, complete with dates and signatures (at least three) are considered a mandatory deliverable and annex to the Technical Report. Failure to deliver this annex will automatically result in a “denied” flight status. Although there is no requirement for burst pressure testing, a rigorous verification & validation test plan typically includes a series of both non-destructive (i.e., proof pressure) and destructive (i.e., burst pressure) tests. A series of burst pressure tests performed on the intended design will be viewed favourably. However, this will not be considered an alternative to proof pressure testing of the intended flight article.
Verification Method: T

### 1.65 [RQT-0650] Restricted control functionality
Launch vehicle active flight control systems, if implemented, can only be implemented for pitch and/or roll stability augmentation, for aerodynamic "braking", guided recovery systems, precision landing or guided deployable loads.
Applicability: Active flight control systems
Notes: Any active flight control system implemented in any part of the vehicle, must be clearly described in the Technical Report, as well as under any concept/design report/review. EuRoC staff may make additional requests for information and draft unique requirements depending on the team's specific design implementation. Guidelines and best practices on how to design control actuator systems and recommended flight trajectories can be found in Appendix F.
Verification Method: S

### 1.66 [RQT-0660] Unnecessary for stable flight
Flight vehicles implementing active flight controls shall be naturally stable without these controls being implemented.
Applicability: Active flight control systems
Notes: Attitude Control Systems (ACS) will serve only to mitigate the small perturbations which affect the trajectory of a stable rocket that implements only fixed aerodynamic surfaces for stability.

The launch vehicle may be flown with the Control Actuator System (CAS) — including any control surfaces — either removed or rendered inert and mechanically locked, without becoming unstable during ascent.

The organisers may make additional requests for information and draft unique requirements depending on the team's specific design implementation.
Verification Method: A, C

### 1.67 [RQT-0670] Designed to fail safe
Control Actuator Systems shall be designed to Fail Safe in any abnormal condition or during an active flight abort (if such functionality is implemented).
Applicability: Active flight control systems
Notes: Designed to fail safe means disabling cold-gas thrusters, returning control surface deflections to neutral position, disabling thrust vectoring, or seeking to disable any control feature which will apply any kind of moment to the flight vehicle.

 As for any actuators acting in a uniform, interlocked or mirrored fashion, which increases air drag without applying any moment to the flight vehicle (such as airbrakes) these shall be attempted fully extended in a fault or abort scenario, to slow down the flight vehicle as quickly as possible.

If within the capability of the Control Actuator System, pilot chutes and even main parachutes can be ejected as soon as the vehicle forward velocity is low enough not to snap the parachute lines.
Verification Method: A, IDT

### 1.68 [RQT-0680] Boost phase dormancy
Control Actuator Systems shall be designed with a field adjustable boost dormancy capability, which will disable them in the initial period of the flight.
Rationale: In enforcing a boost dormancy phase, any unexpected, erratic, or faulty CAS behaviour will take place far from the launch rail, minimizing the chances of putting EuRoC participants at risk.
Applicability: Active flight control systems
Notes: For any CAS without demonstrated flight history and a documented SW configuration control, the boost phase dormancy shall end at an altitude of no less than 1500 m AGL.

For any CAS with a limited demonstrated flight history, the default boost phase dormancy expiration criteria is an altitude of 500 m AGL, subject to EuRoC officials' assessment.

For any CAS with adequate demonstrated flight history, ample simulation models, SW configuration control, single-fault tolerant design/FMECA analysis, etc., the boost phase dormancy expiration altitude may on a case-by-case basis be set as low as the end of the launch rail.

The EuRoC officials can set the boost dormancy phase expiration criteria higher as seen fit. In case the CAS is only capable of exerting longitudinal roll control please refer to Appendix F1 for more information.
Verification Method: A, I

### 1.69 [RQT-0690] Active flight control system electronics
All electronics shall comply with the recovery systems redundant electronics and safety critical wiring specified in Sections 5.1 (EuRoC-LV-RQT-0240 and EuRoC-LV-RQT-0260 to EuRoC-LV-RQT-0280) and 5.4 respectively
Applicability: Active flight control system
Notes: In this case "initiation" refers to CAS commanding rather than a recovery event.
Verification Method: SC

### 1.70 [RQT-0700] Active flight control system energetics
All stored-energy devices used in an active flight control system (i.e., energetics) shall comply with the energetic device requirements defined in Section 6.1 of this document.
Applicability: Active flight control system energetics
Verification Method: S

### 1.71 [RQT-0710] Venting
All non-pressurized compartments of the airframe shall be vented in such a way that the pressures during flight are never above 1,05 times the atmospheric pressure at that point in the flight.
Rationale: Prevent unintended internal pressures developed during flight from causing either damage to the airframe or any other unplanned configuration changes
Applicability: Airframe non-pressurized compartments
Notes: Typically, a 3 mm to 5 mm hole is drilled in the booster section just behind the nosecone or payload shoulder area, and through the hull or bulkhead of any similarly isolated compartment/bay.
Verification Method: S, SC, C

### 1.72 [RQT-0720] Material selection
PVC (and similar low-temperature polymers) Public Missiles Ltd. Quantum Tube components shall not be used in any structural (i.e., load bearing) capacity, most notably as load bearing eyebolts, launch vehicle airframes, or propulsion system combustion chambers
Applicability: Load bearing structures
Verification Method: S

### 1.73 [RQT-0730] Load bearing eyebolts type
All load bearing eyebolts shall be of the closed-eye, forged type.
Applicability: Load bearing eyebolts
Notes: This requirement extends to any bolt and eye-nut assembly used in place of an eyebolt.
Verification Method: SC

### 1.74 [RQT-0740] Load bearing eyebolts and U-bolts material
All load bearing eyebolts and U-Bolts shall be steel or stainless steel.
Applicability: Load bearing eyebolts and U-bolts
Notes: This requirement extends to any bolt and eye-nut assembly used in place of an eyebolt
Verification Method: SC

### 1.75 [RQT-0750] Coupling tubes
Airframe joints which implement "coupling tubes" shall be designed such that the coupling tube extends no less than one body calibre (1D) on either side of the joint — measured from the separation plane.
Rationale: (THIS IS A NOTE)
This requirement applies both for “half” couplings (e.g., nosecone – body tube/coupling tube) as well as for “full” couplings (e.g., body tube – coupling tube – body tube). Regardless of implementation (e.g., RADAX or other joint types) airframe joints need to be "stiff" (i.e., prevent bending).
Applicability: Coupling tubes
Notes: ActiveX VT_ERROR:
Verification Method: A, SC

### 1.76 [RQT-0760] Launch lugs mechanical attachment
Launch lugs (i.e., rail guides) shall implement "hard points" for mechanical attachment to the launch vehicle airframe.
Rationale: Assist in mitigating lug "tear outs" during operations.
Applicability: Launch lugs
Notes: Hardened/reinforced areas on the vehicle airframe, such as a block of wood installed on the airframe interior surface where each launch lug attaches.
Verification Method: SC

### 1.77 [RQT-0770] Aft launch lug support
The aft most launch lug shall support the launch vehicle's fully loaded launch weight while vertical.
Applicability: Aft launch lug
Notes: EuRoC staff will require teams to lift their launch vehicles by the rail guides. This test needs to be completed successfully before the admittance of the team to Launch Readiness Review.
Verification Method: I, T

### 1.78 [RQT-0780] RF transparency
Any internally mounted RF transmitter, receiver or transceiver, not having the applicable antenna(s) mounted externally on the airframe, shall employ “RF windows" in the airframe shell plating (typically glass fibre panels).
Rationale: Enable devices with antennas mounted inside the airframe, to transmit the signal through the airframe shell.
Applicability: Internally RF devices
Notes: RF transmitters, receivers or transceivers are not allowed to be mounted externally.
Verification Method: S

### 1.79 [RQT-0790] RF windows dimensioning
RF windows in the flight vehicle shell shall be a 360° circumference and be at least two body calibres in length.
Applicability: RF windows
Notes: Even though a single downward facing antenna mounted on a stabilization fin near the engine seems like a good way to provide nearly a 360° radiation pattern from a single antenna without significant dead-zones, this is not true when the rocket engine is active, since the ionized exhaust gas from the engine is highly disruptive to RF signals, so degradation or loss of link is to be expected.
Verification Method: S

### 1.80 [RQT-0800] RF windows material
RF windows shall be of a material other than carbon fibre
Rationale: Carbon fibre is conductive and will significantly shield and/or degrade RF signals.
Applicability: RF windows
Notes: Externally mounted antennas often provide a more powerful and uniform radiation pattern but finds the flight vehicle body providing RF dead zones, meaning that at least two antennas on opposite sides of the airframe are advisable
Verification Method: S

### 1.81 [RQT-0810] RF antennas’ location
RF antennas shall be kept as far away as possible from wiring and metallic structural elements.
Rationale: Poor installation practice degrades telemetry and link performances.
Applicability: RF antennas
Notes: Teams are highly advised to follow best RF-practices.
Verification Method: S

### 1.82 [RQT-0820] Internal RF antennas’ location
The internally mounted RF antenna(s) shall be placed at the midpoint of the RF window section.
Rationale: Facilitate maximizing the azimuth radiation pattern
Applicability: Internal RF antennas
Verification Method: S

### 1.83 [RQT-0830] Identifying markings
The Team ID shall be clearly and prominently displayed on the launch vehicle airframe, visible on all four quadrants of the vehicle, as well as fore and aft, and on all components that separate from the vehicle such as deployable payloads.
Rationale: Assist EuRoC officials to identify the project hardware with its respective team throughout EuRoC.
Applicability: Airframe and components with separation from the vehicle
Notes: As a recommendation for the airframe coloration, mostly white or lighter tinted (e.g., yellow, red, orange, etc.) airframes are especially favourable to mitigate the possible solar heating during EuRoC launch environment. Furthermore, high-visibility schemes (e.g., high-contrast black, orange, red, etc.) and roll patterns (e.g., contrasting stripes, “V” or “Z” marks, etc.) allow ground-based observers to track and record the launch vehicle’s trajectory more easily.
Verification Method: S

### 1.84 [RQT-0840] Payloads
Teams are required to carry payload(s) on the vehicle.
Applicability: Aft launch lug
Notes: More information on payload definition and types can be found in Appendix G
Verification Method: S

### 1.85 [RQT-0850] Payload form factor
Payloads shall fulfil one of following basic form factors:
- CanSat: cylindrical shape with 115 mm height and 66 mm diameter;
- CubeSat: cubic shape with one CubeSat Unit (1U) being defined as a 100 mm x 100 mm x100 mm cubic structure;
- PocketSat: cubic shape with 50 mm x 50 mm x 50 mm.
Applicability: Payloads
Notes: The volume of the payload may be a multiple/stack of the basic payload form factors, e.g., 3 CanSats (345 mm height x 66 mm diameter), 2U (200 mm x 100 mm x 100 mm), 5 PocketSats (250 mm x 50 mm x 50 mm) or likewise.

 Teams intending on carrying payloads which do not fulfil the payload form factor, require prior case-by-case review and EuRoC approval. In case of approval there will be a negative impact on the scoring since the payload is still not compliant with the requirement.
Verification Method: S

### 1.86 [RQT-0860] Payload minimum mass
The launch vehicle shall carry no less than 1000 g of payload, with no requirement applicable to the upper limit.
Applicability: Payloads
Notes: A weigh-in will be conducted during Flight Readiness Review. Competition officials will accept payload weigh-ins as much as 5% (50 g) less than the specified minimum. If this requirement is not met, “nominal” flight status may be denied, resulting in an action item to increase payload mass.

 If a functional payload is chosen, with the functional part itself not providing enough mass to reach the minimum requirement, additional dummy-masses may be added to the functional payload until the requirement is reached.

 Examples of payloads fulfilling the minimum mass requirement can be found in Appendix G2.
Verification Method: I

### 1.87 [RQT-0870] Payload mass factor
Payloads shall fulfil one of the following basic mass increments:
- A single CanSat-type payload has a mass between 300 g and 350 g;
- A single CubeSat-type payload has a mass between 1000 g and 1330 g;
- A single PocketSat-type payload has a mass between 200 g and 250 g.
Applicability: Payloads
Verification Method: S

### 1.88 [RQT-0880] Independent payload functionality
The payload functionality must be completely independent of the launch vehicle and at the same time payloads cannot be a part of the launch vehicle functionality (e.g., a guidance and control system).
Applicability: Payloads
Notes: Launch vehicle recovery systems shall be able to bring the vehicle down in a safe and controlled manner, as per the recovery system requirements, independently of whether the payload is active, passive, deployable or fixed inside the launch vehicle.
Verification Method: S

### 1.89 [RQT-0890] Payload removal for weigh-in
Teams must ensure that the payloads shall not be inextricably connected to other launch vehicle associated components (e.g., recovery system, internal structure, or airframe) while being weighed.
Applicability: Payloads
Notes: If the payload cannot be removed for weigh-in, the team will not get points for an onboard payload.

 Neither the payload's location in the launch vehicle nor its method of integration and removal is specified
Verification Method: I

### 1.90 [RQT-0900] Payload materials
Payloads shall not contain significant quantities of lead or any other hazardous materials, and in case of payloads with potential biohazards such as seeds or living beings, those must not contain invasive species. The use of radioactive materials is not permitted.
Applicability: Payloads
Notes: In case of doubts or concerns on hazardous materials, please consult the European Chemicals Agency (ECHA) database (https://echa.europa.eu/information-onchemicals/cl-inventory-database).

For more information on the invasive species both plantae and animalia in Portugal, please refer to the following:
• Plants/seeds: https://invasoras.pt/en/invasive-species-in-portugal;
• Global Register of Introduced and Invasive Species: https://griis.org/viewchecklist?id 4f94d674-5a95-4c2c-9213-54881beed63a.
 • In the documentation submitted to EuRoC, teams shall specify the scientific name of the species and not only the generic name. The EuRoC organisation reserves the right to prohibit the deployment of payloads in case of safety concerns.
Verification Method: S

### 1.91 [RQT-0910] Payload energetic devices
All stored-energy devices (i.e., energetics) used in payload systems shall comply with the energetic device requirements defined in Section 6.1 of this document.
Applicability: Payloads energetics
Verification Method: S

### 1.92 [RQT-0920] Recovery system
Deployable payloads shall have its own independent recovery system.
Applicability: Deployable payloads
Verification Method: S

### 1.93 [RQT-0930] Unique recovery system
If teams plan to develop a deployable payload that requires a specific unique recovery system, they shall contact the EuRoC organization well in advance of the event to clarify if the payload satisfies all requirements.
Applicability: Deployable payloads
Verification Method: A, IDT

### 1.94 [RQT-0940] Descent velocity
Deployable payloads shall incorporate an independent recovery system, reducing the payload's descent velocity to less than 9 m/s before it descends through an altitude of 450 m AGL.
Applicability: Deployable payloads
Verification Method: A, C

### 1.95 [RQT-0950] Recovery system electronics
Payloads implementing independent recovery systems shall comply with the launch vehicle redundant electronics requirements defined in Section 5.1 (EuRoC-LV-RQT-0240 to EuRoC-LV-RQT0280).
Applicability: Deployable payloads
Verification Method: I

### 1.96 [RQT-0960] Payload safety critical wiring
Payloads implementing independent recovery systems shall comply with the launch vehicle safety critical wiring requirements defined in RQT-0510 to RQT-0530
Applicability: Deployable payloads
Verification Method: I

### 1.97 [RQT-0970] Recovery system testing
Payloads implementing independent recovery systems shall comply with the launch vehicle recovery system testing requirements defined in Section 0
Applicability: Deployable payloads
Verification Method: T

### 1.98 [RQT-0980] Payload tracking
All deployable payloads shall feature the mandatory altitude logging and tracking system (see Section 5.3).
Rationale: Deployable payloads are equivalent to flight vehicle bodies and sections and can be difficult to locate after landing.
Applicability: Deployable payloads
Verification Method: S

### 1.99 [RQT-0990] Payload tracking call-sign
Teams shall assign to each transmitter a call-sign respecting the format described in Appendix D.
Applicability: Deployable payloads
Notes: The landing site tracking locator ID must differ from the ID of the launch vehicle
Verification Method: S

### 1.100 [RQT-1000] Launch azimuth and elevation
Launch vehicles shall nominally launch at an elevation angle of 84°±1° and a launch azimuth defined by the organisation at EuRoC.
Applicability: All launch vehicles
Notes: Competition officials reserve the right to require certain vehicles' launch elevation to be as low as 70° if flight safety issues are identified during pre-launch activities.

The tolerance expressed within the nominal launch azimuth is an expression of acceptable human error by the operator setting the launch rail elevation prior to launch.
Verification Method: S

### 1.101 [RQT-1100] Rail take-off velocity
The vehicle shall be capable of achieving a rail departure speed higher than 30 m/s on the intended launch rail's length.
Applicability: All launch vehicles
Notes: This requirement shall be verified by analysis of the flight simulations, experimental thrust curves, and other vehicle data (i.e., by design, the vehicle in nominal conditions goes off the rail at more than 30 m/s)

Teams, particularly those with hybrid and liquid propulsion plants, should design their propulsion plants with ample (or even considerable) power margin. An overpowered propulsion system is preferable to an under-powered propulsion system.

Departing the launch rail is defined as the first instant in which the launch vehicle becomes free to move about the pitch, yaw, or roll axis. This generally occurs at the instant the last rail guide forward of the vehicle's centre of gravity (CG) separates from the launch rail.
Verification Method: C

### 1.102 [RQT-1020] Hold-down system
All vehicles using at least one liquid propellant shall employ a hold-down system that will release the rocket only after sufficient thrust for stable flight is achieved.
Applicability: Hybrid and Liquid launch vehicles
Notes: The hold-down mechanism may be actively or passively release. The holding force should be distributed symmetrically on the airframe. For use with the EuRoC rail, additional accessories may need to be fitted.
Verification Method: I, C, T

### 1.103 [RQT-1030] Stability margin
Launch vehicles shall maintain a static stability margin of at least 1,5 calibres throughout the whole flight phase (upon leaving the launch rail), regardless of CG movement due to depleting consumables and shifting CP location due to wave drag effects (which may become significant as low as 0,5 Mach).
Applicability: All launch vehicles
Notes: All launch vehicles should avoid becoming over-stable during ascent, meaning with a static margin significantly greater than 2 body calibres (e.g., greater than 6 body calibres).

Sloshing effects of fluids on payloads, should also be taken into consideration during calculations.
Verification Method: C

## 2 [Aurora Requirements!NRC REQ] References to Aurora Requirements.xlsx (NRC REQ) (Container)
Imported from Microsoft Excel

### 2.1 [Competition Requirment ID] Requirement Title
Additional Notes: Additional Notes
Verification Method: Verification Method

### 2.2 [MRD-MIS-001] The launch vehicle should reach an apogee of 2500ft.
If a rocket exceeds an apogee of 3000ft, they are required to incorporate a dual-deployment recovery system according to Midlands Rocketry Club Rules.
Rationale: Any launch vehicle which passes the 3000ft altitude line must be equipped with a dual-deployment recovery system as per the rules of the site. This is for safety reasons and cannot be disregarded.
Additional Notes: Marks are given based on the apogee reached. 100% of the marks are achieved if an apogee of exactly 2500ft is reached.
Verification Method: A

### 2.3 [MRD-MIS-002] The launch vehicle shall not fly above 3000ft without a dual deployment recovery system.
The Competition's launch site is overseen by the Midlands Rocketry Club, which can only secure a maximum altitude of 3500ft on the day. Rockets MUST NOT exceed this altitude.
Rationale: Launch vehicles travelling higher than 3500 pose a serious risk to low-flying aircraft and violate the MRC's agreement with the UK Civil Aviation Authority.
Additional Notes: Since the goal is to reach an apogee of 2500ft, passing an apogee of 3000ft will result in heavy penalisations and deduction of points.
Verification Method: A

### 2.4 [MRD-MIS-003] The launch vehicle shall not fly above the Midlands Rocketry Club's NOTAM limit.
Competition restrictions dictate that only certain approved motors can be used in the NRC. Self-made motors are not allowed. Cesaroni and AeroTech motors are standard on the UK Market, and have been approved by UKSEDS for competition use.
Rationale: Teams are provided with these G-Class motors because they are classified as mid-power motors and do not require UKRA certification to purchase or fly.
Additional Notes: Any rockets which pass a maximum altitude of 3500ft will be automatically given 0 marks, and will be heavily penalised.
Verification Method: A

### 2.5 [MRD-MIS-004] The launch vehicle shall be powered by a 2-grain 29mm G-class ammonium perchlorate solid rocket motor with a total impulse under 130Ns.
Due to safety and competition restrictions, only approved motors can be used in NRC. UKSEDS will not allow self-made motors or motors from unlicensed manufacturers.
Rationale: Motors from Cesaroni and AeroTech are UKSEDS verified and approved, and have been allowed for competition use.
Additional Notes: These motors have a total impulse under 130Ns. Be mindful of this when designing the rocket.
Verification Method: D

### 2.6 [MRD-MIS-005] The rocket motor shall be supplied by Cesaroni Technology Inc. or AeroTech.
Significant issues have arisen in previous years with communication between teams and motor suppliers. The NRC organising team are the only group communicating with motor suppliers about motor orders. This ensures all motors are handled correctly by qualified persons.
Rationale: NRC Organising teams communicating directly with reliable motor providers results in less confusion and issues with motor sourcing. By obtaining motors through the UKSEDS' NRC Organising team, the motors will be handled correctly and will be safe for use.
Additional Notes: N/A
Verification Method: D

### 2.7 [MRD-MIS-006] The rocket motor shall be obtained through UKSED's NRC Organising team.
The rideshare payload will be provided by teams, and they are able to decide what it will be.
Rationale: N/A
Additional Notes: N/A
Verification Method: D

### 2.8 [MRD-MIS-007] The launch vehicle shall carry a rideshare payload with a minimum weight of 100g.
N/A
Rationale: N/A
Additional Notes: The rideshare payload will need to provide power to "The Customer's" payload. The requirements given elsewhere should provide more information on what this payload should include.
Verification Method: D

### 2.9 [MRD-CPD-001] The launch vehicle shall provide a DC bus voltage of 3.5-5Volts to "The Customer's" payload.
This 45 minute window includes time on the pad, flight and recovery. This assumes the rocket will be on the pad for 15 minutes.
Rationale: "The Customer's" payload will need power before and after flight. As such, it is appropriate to assume 45 minutes of power will suffice.
Additional Notes: The rideshare payload will need to be the component which provides the necessary voltage.
Verification Method: D,T

### 2.10 [MRD-CPD-002] The launch vehicle shall provide power to "The Customer's" payload for a minimum of 45 minutes.
N/A
Rationale: If insufficient current is provided, "The Customer's" payload will be unable to carry out its function.
Additional Notes: N/A
Verification Method: D

### 2.11 [MRD-CPD-003] The launch vehicle shall provide sufficient current to power "The Customer's" payload.
The payload only needs to be powered via the top or bottom port. Two options have been given to provide the participants with design flexibility.
Rationale: The payload will have a male XT30 connector, so the team will need to provide a female connector.
Additional Notes: N/A
Verification Method: D,T

### 2.12 [MRD-CPD-004] The launch vehicle shall provide power via a female XT30 connector at the top and bottom of "The Customer's" payload.
N/A
Rationale: SD Card needed to record flight data.
Additional Notes: See the photos under NRC CAD tab for a visual representation.
Verification Method: D

### 2.13 [MRD-CPD-005] The launch services provider shall provide a microSD with a minimum of 16GB of storage for "The Customer's" payload.
The launch vehicle adapter file will be shared with teams through the documentation page on the website. The team is expected to print this adapter and provide it. Having an NRC organiser distributed design would reduce interface issues on launch day.
Rationale: "The Customer's" payload needs to interface with the launch vehicle to remain secure throughout flight.
Additional Notes: N/A
Verification Method: D

### 2.14 [MRD-CPD-006] The launch vehicle shall mechanically interface with "The Customer's" payload via the launch vehicle's adapter.
Teams should design a payload bay to have a small amount of extra space to account for any tolerancing issues. Print out a copy of the dummy "Customer's" payload to carry out checks and determine an assembly procedure before competition day.
Additional Notes: Teams can modify the launch vehicle adapter to interface with the rocket design, but the face which meets with the payload should remain untouched.
Verification Method: D,T

### 2.15 [MRD-CPD-007] The launch vehicle shall provide a minimum payload bay of 40mm in diameter and 53mm in length for "The Customer's" payload (not including the launch vehicle adapter).
See the NRC CAD tab for a visual diagram.
Rationale: N/A
Additional Notes: Checking that the payload bay will meet these requirements is vital to the success of the launch. This should be tested and checked thoroughly before launch day.
Verification Method: D

### 2.16 [MRD-CPD-008] The thrust vector of the launch vehicle shall go through the centre of "The Customer's" payload.
N/A
Rationale: The camera hole and screw switch hole should be accessible from the outside of the rocket.
Additional Notes: N/A
Verification Method: D

### 2.17 [MRD-CPD-009] The launch vehicle shall provide permanent external access to the following points for "The Customer's" payload. (See the points circled in RED in the NRC CAD tab)
The payload bay should be unpressurised to ensure "The Customer's" payload can determine the altitude of the launch vehicle.
Rationale: Unpressurised to allow altitude recordings.
Additional Notes: N/A
Verification Method: D

### 2.18 [MRD-CPD-010] The launch vehicle payload bay shall be unpressurised.
Bolts are needed to "mate" the payload adapter and the payload to each other. 3 M3 bolts are required as standard; however, teams are advised to bring spares in a variety of lengths.
Rationale: Teams will modify the launch vehicle adapter, so will need their own bolts of varying lengths.
Additional Notes: N/A
Verification Method: D

### 2.19 [MRD-CPD-011] Teams shall provide their own bolts to mount "The Customer's" payload into the vehicle launch adapter.
This PCB should be designed fresh for this year's competition. Training courses will be sent to teams in due course throughout the year.
Rationale: A new PCB should be designed by the teams to ensure fairness.
Additional Notes: UKSEDS will have a small amount of spare M3 bolts in various sizes.
Verification Method: D

### 2.20 [MRD-RPD-001] The rideshare payload shall contain a printed circuit board designed from scratch.
IMU's have a tendency to drift quickly with time, leading to inaccurate results. Hence, barometers should be used instea
Rationale: N/A
Additional Notes: N/A
Verification Method: D

### 2.21 [MRD-RPD-002] The rideshare payload shall detect the launch vehicle's altitude.
The payload does not have to have a screen to show the graph, and an external screen, like a laptop, may be used to accomplish this.
Rationale: N/A
Additional Notes: N/A
Verification Method: D

### 2.22 [MRD-RPD-003] The rideshare payload shall be able to produce an altitude vs. time plot in feet per second within 10 minutes of launch vehicle recovery.
Tools can be used to gain access to the rideshare payload, but equipment like laptops cannot be used to retrieve apogee data from the rideshare payload.
Rationale: N/A
Additional Notes: N/A
Verification Method: D

### 2.23 [MRD-RPD-004] The rideshare payload shall be able to provide an apogee value in feet within 10 minutes of recovery without the use of external equipment.
N/A
Rationale: N/A
Additional Notes: N/A
Verification Method: D

### 2.24 [MRD-RPD-005] The rideshare payload shall have a silkscreen on the printed circuit board containing the team logo.
External equipment may be used to display this data. The data must not be collected with the same sensor used for MRD-RPD-002.
Rationale: N/A
Additional Notes: N/A
Verification Method: D

### 2.25 [MRD-RPD-006] The rideshare payload should record at least one extra type of data and present this within 10 minutes of recovery.
The rocket motor/motor case shall be clamped axially at both ends.
Rationale: The motor must be securely mounted in the launch vehicle, or it could break free and pose a safety risk.
Additional Notes: N/A
Verification Method: D

### 2.26 [TSN-MOR-001] Mounting of the motor in the rocket.
The rocket motor mount shall be designed to withstand a force equivalent to twice the maximum motor thrust without permanent deformation.
Rationale: Designing the mount to tolerate thrust forces above what is expected will result in a reliable mount which will not fail during launch or flight.
Additional Notes: Single-use or reload motors are the only 2 types of motors allowed under NRC rules. Since single-use motors do not have a case, they should be directly clamped to the launch vehicle. Reload motors need a case, and this case should be clamped to the launch vehicle. The mount used must transmit thrust loads from the motor to the structure of the rocket, and the motor must not slip out during handling or flight.
Verification Method: D

### 2.27 [TSN-MOR-002] Motor Mount Strength Requirements
The rocket motor shall be designed to withstand a lateral force in any direction equal to a thrust misalignment of 5 degrees at the maximum motor thrust cantilevered about the vehicle's centre of gravity.
Rationale: If the motor mount is unable to withstand all thrust loads (both axial and lateral), then the mount may critically fail, resulting in loss of the launch vehicle and a potential safety hazard.
Verification Method: T

### 2.28 [TSN-MOR-003] Motor Mount Strength Requirements
The launch rail at Midlands rocketry club will be approximately 2 metres.
Verification Method: T

### 2.29 [TSN-SMN-001] The rocket shall have a minimum velocity of 20m/s when leaving the launch rail.
The static stability margin is the distance between the centre of mass and the centre of pressure.
Verification Method: A

### 2.30 [TSN-SMN-003] The rocket shall have a stability margin between 1.5 and 2.5 diameters during all phases of flight before apogee.
The geometric alignment of each fin shall be within 2 degrees of the projected longitudinal axes of symmetry of the rocket.
Verification Method: A

### 2.31 [TSN-SAR-001] Fin Alignment
Each fin must be able to support a suspended load from its tip equal to twice the fin mass times the rocket's maximum axial acceleration during any flight phase.
Verification Method: I

### 2.32 [TSN-SAR-002] Fin Longitudinal Loading
Each fin shall withstand a transverse load equal to the rocket's launch mass when suspended from the fin tip with a maximum lateral deflection of less than 10 degrees in either rotational direction.
Verification Method: T

### 2.33 [TSN-SAR-003] Fin Lateral Loading
The launch-ready rocket shall deflect less than 10mm per metre length in any lateral direction when suspended from it's centre of mass.
Verification Method: T

### 2.34 [TSN-SAR-004] Fuselage Stiffness
The mating length between a coupler and body tube shall be a minimum of 1 body tube diameter when using plastics or composites.
Rationale: When rockets are coupled together using several tubes, the way the tubes are joined can often lead to unsatisfactory levels of stiffness. To prevent this flexing along the rocket body, the minimum mating length should be 1 body tube diameter.
Verification Method: T

### 2.35 [TSN-SAR-005] Fuselage Stiffness
All structural parts used shall withstand twice their expected maximum inertial and aerodynamic loads without failure.
Additional Notes: If sliding connections are used, the minimum mating length between a coupler and tube should always be 1 diameter. Additionally, the fit between parts must stop any noticeable rotation at the joint.
Verification Method: D

### 2.36 [TSN-SAR-006] Static Strength Requirements
All rockets shall be equipped with a minimum of 2 rail buttons.
Rationale: At the Midlands Rocketry Club, teams usually fly on 2m rails, which are compatible with 6mm launch buttons.
Additional Notes: If teams wish to re-use a launch vehicle, all parts must withstand 1.5x applied loads without permanent deformation.
Verification Method: T

### 2.37 [TSN-SAR-007] Launch Lug
Finite Element Analysis (FEA) shall not be used to produce evidence for any structural requirements.
Rationale: Incorrect assumptions are often made using FEA, leading to previous issues in flight readiness review, where designs cannot pass real-world structural tests.
Additional Notes: NRC recommends that delrin rail buttons are used.
Verification Method: D

### 2.38 [TSN-SAR-008] Finite Element Analysis
The rocket shall be capable of being switched on and left to run using its internal power source for a minimum of 15 minutes on the launch pad.
Rationale: Energy is needed for "The Customer's" payload to carry out it's functions. As such, at least 15 minutes of power is needed on the launch pad.
Additional Notes: Teams are encouraged to learn FEA for NRC, and are welcome to use it in competition reports and documentation as supplementary evidence. It cannot be used, due to safety reasons, for verifying structural requirements.
Verification Method: D

### 2.39 [TSN-ESS-001] Internal Power Supply
The rocket shall be capable of being armed within 5 minutes at the launch site.
Rationale: Many delays on competition days are caused by teams having to fully disassemble their rockets to arm them or switch on a payload. A rocket which can be quickly armed will reduce delays on the day and help the competition to run smoothly.
Additional Notes: Teams should ideally have a way to arm the rocket externally, so it can be armed on the launch pad. If this is not possible, it will need to be powered on for much longer (up to 1 hour) on the launch day before being placed on the pad.
Verification Method: A

### 2.40 [TSN-ESS-002] Internal Power Supply
The rocket shall not contain single-core wire.
Rationale: Single-core wire is considered too fragile to be used as the electrical cable for primary systems. Multi-core wire is tougher and more reliable.
Additional Notes: It is highly advisable for rockets to be armed externally using a pull pin or screw switch.
Verification Method: D

### 2.41 [TSN-ESS-003] Electrical Considerations
Teams shall conform to Ofcom's IR 2030 radio frequency regulations.
Rationale: Ofcom limits the type of radio frequencies which can be used recreationally.
Additional Notes: During assembly, testing and flight, electronic circuits and wiring will be subjected to high levels of abuse. Hence, construction should be rugged and to a high standard of workmanship. Teams should be careful when using electromechanical components, and ensure that the components can withstand high acceleration and vibration loads. Switches should be placed in the correct orientation, as they can only withstand high G loads along certain axes. Recovery system deployment shock loads are an important factor to consider because they can exceed thrust loads.
Verification Method: D

### 2.42 [TSN-ESS-004] Radio Frequencies
The rocket shall have a recovery system.
Rationale: All rockets must have a system to recover them in a safe and controlled fashion. This can be accomplished using a parachute, which is deployed when a rocket reaches apogee.
Additional Notes: See Ofcom's IR 2030 document (latest version) to ensure they are complying with regulations. 868MHz and 433MHz are the 2 most popular choices.
Verification Method: D

### 2.43 [TSN-RRS-001] Use of Recovery System
The recovery system shall reduce the rocket's vertical landing speed to less than 15m/s.
Rationale: This can be demonstrated using Open Rocket simulations if using a parachute based recovery system. If an alternative system is used, then its effectiveness should be demonstrated with hand calculations and a possible real-world test.
Verification Method: D

### 2.44 [TSN-RRS-002] Landing Speeds
After reaching apogee, the rocket shall not drift more than 1 kilometre before landing at wind speeds of 15m/s.
Rationale: Rockets need to land inside the landowner's boundaries; hence a 1km radius shall be used.
Verification Method: A

### 2.45 [TSN-RRS-003] Maximum Post-Apogee Range
If a flight computer is used for recovery, it shall be a COTS or UKRA qualified system.
Rationale: The purpose of a flight computer is to activate the recovery system when the rocket reaches apogee. COTS means 'commercial-off-the-shelf'. This means teams cannot design an in-house recovery computer to operate on its own.
Additional Notes: The prospective launch site is quite windy, but all rockets must still land within the boundaries. It is recommended to make the recovery device highly visible to assist recovery.
Verification Method: A

### 2.46 [TSN-RRS-004] Flight Computer
Any electronic recovery circuits should be electrically isolated from other electronic systems.
Additional Notes: Teams are allowed to use an SRAD (student-researched-and-developed) flight computer that has been flight qualified to UKRA's standards. Teams can develop their own recovery circuits, but as per UKRA safety code section 2, this will mean the rocket is classed as experimental, and so UKRA section 8 applies. This means that SRAD recovery electronics must be flown as backup to a COTS recovery system until they have been qualified.
Verification Method: D

### 2.47 [TSN-RRS-005] Isolation of Recovery Circuit
Tilt Switches shall not be used.
Rationale: Inaccuracy in tilt switches means they are not viable detectors.
Additional Notes: It is recommended that all of the recovery sequencing circuitry be electrically isolated (including batteries) from any other circuit in the rocket.
Verification Method: D

### 2.48 [TSN-RRS-006] Detection of Apogee
Any flight computers used to trigger recovery systems shall have an externally accessible disarming mechanism.
Rationale: The flight computer (if used) must have a safe disarming mechanism to prevent inadvertent activation of the recovery system during handling and loading. Otherwise, pyrotechnic actuators could go off and cause damage.
Additional Notes: Detectors relying on the physical orientation of the rocket relative to gravity vector to detect apogee are inaccurate and shouldn't be used.
Verification Method: D

### 2.49 [TSN-RRS-007] Flight Computer Disarming System
Recovery loads shall be transmitted via eye bolts through bulkheads with a nut on the other side.
Additional Notes: The system must be kept in a disarmed (safe) condition until the rocket is safely loaded onto the launch pad.
Verification Method: D

### 2.50 [TSN-RRS-008] Transmission of Recovery Shock Loads
Recovery systems which use shock cords shall have a minimum length of 2m.
Rationale: Enough length of cord is needed to safely dissipate energy released during airframe seperation.
Additional Notes: The main recovery shock loads must not be transmitted in shear through screw threads into the rocket body.
Verification Method: D

### 2.51 [TSN-RRS-009] Shock Cord
Any shock cords shall be made of kevlar.
Rationale: A cheap and strong material.
Additional Notes: Since a lot of energy is released when an ejection charge goes off, the shock cords used need to be a sufficient length to prevent shock cord snapping.
Verification Method: D

### 2.52 [TSN-RRS-010] Shock Cord
All rockets must conform to CAA UAS laws.
Additional Notes: Relatively inexpensive compared to alternative cords.
Verification Method: D

### 2.53 [TSN-ARY-001] Alternative Recovery Definition
All rockets must conform to UKRA safety code.
Additional Notes: See Civil Aviation Authority documentation regarding this.
Verification Method: D

### 2.54 [TSN-ARY-002] Alternative Recovery Definition
Active stabilisation shall only be used on ascent.
Additional Notes: Model Rocket Safety Code – UKRA
Verification Method: D

### 2.55 [TSN-ARY-003] Active Stabilisation and Recovery
Active stabilisation shall only be used on ascent.
Notes: As per UKRA's safety code, active stabilisation can only be used on ascent. Active recovery must only be used to guide the rocket back to the launch site on descent.
Verification Method: D